# Dynamo graph Home.dyn (Dynamo 2.13.1.3887)

file_path = Filename(".\corners_ceiling.csv")
file_path_2 = Filename(".\corners_floor.csv")
file_path_3 = Filename(".\corners_wall.csv")
list_create = List.Create(item0=file_path, item1=file_path_2, item2=file_path_3)
boolean = BoolSelector(false)
importCSV = Data.ImportCSV(filePath=list_create, transpose=boolean)
number = DoubleInput(0)
getItemAtIndex = List.GetItemAtIndex(list=importCSV, index=number)
number_2 = DoubleInput(1)
getItemAtIndex_2 = List.GetItemAtIndex(list=importCSV, index=number_2)
number_3 = DoubleInput(2)
getItemAtIndex_3 = List.GetItemAtIndex(list=importCSV, index=number_3)
byCoordinates = Point.ByCoordinates(x=getItemAtIndex, y=getItemAtIndex_2, z=getItemAtIndex_3)
boolean_2 = BoolSelector(true)
byPoints = PolyCurve.ByPoints(points=byCoordinates, connectLastToFirst=boolean_2)
byPatch = Surface.ByPatch(closedCurve=byPoints)
number_4 = DoubleInput(1)
thicken = Surface.Thicken(surface=byPatch, thickness=number_4)
map = List.Map(list=byCoordinates)  # unwired: function
python_script = Python(IN[0]=getItemAtIndex, IN[1]=getItemAtIndex_2, IN[2]=getItemAtIndex_3)  # CPython3
# ---------- python_script.python (28 lines) ----------
# Python 표준 및 DesignScript 라이브러리 로드
import sys
import clr
clr.AddReference("ProtoGeometry")
from Autodesk.DesignScript.Geometry import PolyCurve, Point

# 예: x_coords = [1,2,3], y_coords = [4,5,6], z_coords = [7,8,9]
x_coords = IN[0]
y_coords = IN[1]
z_coords = IN[2]


# pointsList가 None이면(값이 없으면) 에러 처리
if x_coords is None:
    OUT = "pointsList is None. Check CSV path or function output!"
else:
    # 각 좌표를 Point로 바꾼 뒤, PolyCurve 생성
    polyCurves = []
    for i in range(len(x_coords)):
        x = x_coords[i]
        y = y_coords[i]
        z = z_coords[i]
        p = Point.ByCoordinates(x, y, z)
        points.append(p)

        # 점들을 연결해 폐합 PolyCurve(사각형 등)를 만든다
        polyCurve = PolyCurve.ByPoints(polyCurves, True)
        OUT = polyCurve
# ----------------------------------------
watch = Watch(python_script)
file_path_4 = Filename(".\corners_ceiling.csv")
file_path_5 = Filename(".\corners_floor.csv")
file_path_6 = Filename(".\corners_wall.csv")
list_create_2 = List.Create(item0=file_path_4, item1=file_path_5, item2=file_path_6)
boolean_3 = BoolSelector(false)
importCSV_2 = Data.ImportCSV(filePath=list_create_2, transpose=boolean_3)
number_5 = DoubleInput(0)
getItemAtIndex_4 = List.GetItemAtIndex(list=importCSV_2, index=number_5)
number_6 = DoubleInput(1)
getItemAtIndex_5 = List.GetItemAtIndex(list=importCSV_2, index=number_6)
number_7 = DoubleInput(2)
getItemAtIndex_6 = List.GetItemAtIndex(list=importCSV_2, index=number_7)
byCoordinates_2 = Point.ByCoordinates(x=getItemAtIndex_4, y=getItemAtIndex_5, z=getItemAtIndex_6)
map_2 = List.Map(list=byCoordinates_2)  # unwired: function
python_script_2 = Python(IN[0]=getItemAtIndex_4, IN[1]=getItemAtIndex_5, IN[2]=getItemAtIndex_6)  # CPython3; same code as python_script
watch_2 = Watch(python_script_2)
boolean_4 = BoolSelector(true)
byPoints_2 = PolyCurve.ByPoints(points=byCoordinates_2, connectLastToFirst=boolean_4)
byPatch_2 = Surface.ByPatch(closedCurve=byPoints_2)
number_8 = DoubleInput(1)
thicken_2 = Surface.Thicken(surface=byPatch_2, thickness=number_8)
